# Dynamo graph VT_CorrectionsToDynamo.dyn (Dynamo 0.9.0.3072)

# group: 0
# note: Vanilla

# group: 1
# note: Radial Array
# on XY Plane

# group: 2
# note: Radial Array
# on XZ Plane

# group: 3
# note: Radial Array
# on XZ Plane

# group: 4
# note: Radial Array
# on XZ Plane

# group: Representation of: Wobj O-frame (block)
code_block = CodeBlock { CoordinateSystem.ByOrigin(0,0,0); }

# group: Representation of: Block on end effector
code_block_2 = CodeBlock { 0.4; }
byLengths = Cuboid.ByLengths(code_block, code_block_2, code_block_2, code_block_2)

# group: Representation of: Wobj U-Frames (drill along z-axis)
code_block_3 = CodeBlock()
# ---------- code_block_3.designscript (5 lines) ----------
CoordinateSystem.ByPlane(
 Plane.ByOriginNormalXAxis(
 Point.ByCoordinates(0,0,0),
 Vector.ByCoordinates(-1,-2,-6),
 Vector.ByCoordinates(3,2,1)));
# ----------------------------------------
code_block_4 = CodeBlock()
# ---------- code_block_4.designscript (5 lines) ----------
CoordinateSystem.ByPlane(
 Plane.ByOriginNormalXAxis(
 Point.ByCoordinates(0,0,0),
 Vector.ByCoordinates(-1,7,-6),
 Vector.ByCoordinates(3,2,1)));
# ----------------------------------------
code_block_5 = CodeBlock()
# ---------- code_block_5.designscript (5 lines) ----------
CoordinateSystem.ByPlane(
 Plane.ByOriginNormalXAxis(
 Point.ByCoordinates(0,0,0),
 Vector.ByCoordinates(3,2,-6),
 Vector.ByCoordinates(3,6,3)));
# ----------------------------------------
code_block_6 = CodeBlock()
# ---------- code_block_6.designscript (5 lines) ----------
CoordinateSystem.ByPlane(
 Plane.ByOriginNormalXAxis(
 Point.ByCoordinates(0,0,0),
 Vector.ByCoordinates(3,2,-6),
 Vector.ByCoordinates(-3,-3,3)));
# ----------------------------------------

create = List.Create(code_block_3, code_block_4, code_block_5, code_block_6)

# group: Sample struts
origin = CoordinateSystem.Origin(create)
ZAxis = CoordinateSystem.ZAxis(create)
byStartPointDirectionLength = Line.ByStartPointDirectionLength(startPoint=origin, direction=ZAxis)

# group: Sample node
origin_2 = CoordinateSystem.Origin(code_block)

# group: Get struts that intersect with node and orient to point as necessary.
getLinesAtPoint = Dynamo_TORO.WIP_ROBARCH.getLinesAtPoint(byStartPointDirectionLength, origin_2)

planeAtParameter = Curve.PlaneAtParameter(curve=getLinesAtPoint)

# group: Reorient axes, here reversing and retaining the Z and X axes respectively.
flip_Plane = Dynamo_TORO.WIP_ROBARCH.flip_Plane(planeAtParameter)

directory_path = Directory("C:\Users\Nick Cote\Desktop\TORO\ClassLibrary1\ClassLibrary1\extra")
string = StringInput("test00")

# group: Check if planes are within drill cone.
testAngular_Plane = Dynamo_TORO.WIP_ROBARCH.testAngular_Plane(planeAtParameter)

# group: Sort planes by Z about pole
sortPolar_Plane = Dynamo_TORO.WIP_ROBARCH.sortPolar_Plane(testAngular_Plane)

code_block_7 = CodeBlock { Vector.ByCoordinates(1,0,0); }

# group: Align planes to guide XAxis
alignByXAxis_Plane = Dynamo_TORO.WIP_ROBARCH.alignByXAxis_Plane(sortPolar_Plane, code_block_7)

blockFrame = CodeBlock()
# ---------- blockFrame.designscript (3 lines) ----------
Plane.ByOriginNormal(
 Point.ByCoordinates(0,0,150),
 Vector.ByCoordinates(0,0,1));
# ----------------------------------------
drillFrame = CodeBlock()
# ---------- drillFrame.designscript (4 lines) ----------
Plane.ByOriginNormalXAxis(
 Point.ByCoordinates(300,-260,280),
 Vector.ByCoordinates(0,0,1),
 Vector.ByCoordinates(-1,0,0));
# ----------------------------------------

# group: Create drilling routine
createDrillRoutine3 = Dynamo_TORO.WIP_ROBARCH.createDrillRoutine3(directory_path, string, alignByXAxis_Plane, blockFrame, drillFrame)

code_block_8 = CodeBlock()
# ---------- code_block_8.designscript (14 lines) ----------
val = 0..359..45;
CoordinateSystem.ByPlane(
 Plane.ByOriginNormalXAxis(
 Point.ByCoordinates(0,0,0),
 Vector.ByCoordinates(
  Math.Cos(val),Math.Sin(val),0),
 Vector.ByCoordinates(0,0,-1)
 ));
CoordinateSystem.ByPlane(
 Plane.ByOriginNormalXAxis(
 Point.ByCoordinates(0,0,0),
 Vector.ByCoordinates(0,0,-1),
 Vector.ByCoordinates(1,0,0)
 ));
# ----------------------------------------
create_2 = List.Create(code_block_8.out1, code_block_8.out2)
flatten = Flatten(create_2)

# group: Sample struts
origin_3 = CoordinateSystem.Origin(flatten)
ZAxis_2 = CoordinateSystem.ZAxis(flatten)
byStartPointDirectionLength_2 = Line.ByStartPointDirectionLength(startPoint=origin_3, direction=ZAxis_2)

code_block_9 = CodeBlock { CoordinateSystem.ByOrigin(0,0,0); }

# group: Sample node
origin_4 = CoordinateSystem.Origin(code_block_9)

# group: Get struts that intersect with node and orient to point as necessary.
getLinesAtPoint_2 = Dynamo_TORO.WIP_ROBARCH.getLinesAtPoint(byStartPointDirectionLength_2, origin_4)

planeAtParameter_2 = Curve.PlaneAtParameter(curve=getLinesAtPoint_2)

# group: Reorient axes, here reversing and retaining the Z and X axes respectively.
flip_Plane_2 = Dynamo_TORO.WIP_ROBARCH.flip_Plane(planeAtParameter_2)

directory_path_2 = Directory("C:\Users\Nick Cote\Desktop\TORO\ClassLibrary1\ClassLibrary1\extra")
string_2 = StringInput("test01")

# group: Check if planes are within drill cone.
testAngular_Plane_2 = Dynamo_TORO.WIP_ROBARCH.testAngular_Plane(planeAtParameter_2)

# group: Sort planes by Z about pole
sortPolar_Plane_2 = Dynamo_TORO.WIP_ROBARCH.sortPolar_Plane(testAngular_Plane_2)

# group: Align planes to guide XAxis
alignByXAxis_Plane_2 = Dynamo_TORO.WIP_ROBARCH.alignByXAxis_Plane(sortPolar_Plane_2)

blockFrame_2 = CodeBlock()  # same code as blockFrame
drillFrame_2 = CodeBlock()  # same code as drillFrame

# group: Create drilling routine
createDrillRoutine3_2 = Dynamo_TORO.WIP_ROBARCH.createDrillRoutine3(directory_path_2, string_2, alignByXAxis_Plane_2, blockFrame_2, drillFrame_2)

directory_path_3 = Directory("C:\Users\Nick Cote\Desktop\TORO\ClassLibrary1\ClassLibrary1\extra")
string_3 = StringInput("test02")
code_block_10 = CodeBlock()
# ---------- code_block_10.designscript (7 lines) ----------
val = 90..270..10;
CoordinateSystem.ByPlane(
 Plane.ByOriginNormalXAxis(
 Point.ByCoordinates(0,0,0),
 Vector.ByCoordinates(Math.Cos(val),0,Math.Sin(val)),
 Vector.ByCoordinates(0,1,0)
 ));
# ----------------------------------------

# group: Sample struts
origin_5 = CoordinateSystem.Origin(code_block_10.out1)
ZAxis_3 = CoordinateSystem.ZAxis(code_block_10.out1)
byStartPointDirectionLength_3 = Line.ByStartPointDirectionLength(startPoint=origin_5, direction=ZAxis_3)

reverse = List.Reverse(byStartPointDirectionLength_3)
code_block_11 = CodeBlock { CoordinateSystem.ByOrigin(0,0,0); }

# group: Sample node
origin_6 = CoordinateSystem.Origin(code_block_11)

# group: Get struts that intersect with node and orient to point as necessary.
getLinesAtPoint_3 = Dynamo_TORO.WIP_ROBARCH.getLinesAtPoint(reverse, origin_6)

planeAtParameter_3 = Curve.PlaneAtParameter(curve=getLinesAtPoint_3)
code_block_12 = CodeBlock { 120; }

# group: Check if planes are within drill cone.
testAngular_Plane_3 = Dynamo_TORO.WIP_ROBARCH.testAngular_Plane(planeAtParameter_3, arg2=code_block_12)

# group: Sort planes by Z about pole
sortPolar_Plane_3 = Dynamo_TORO.WIP_ROBARCH.sortPolar_Plane(testAngular_Plane_3)

# group: Align planes to guide XAxis
alignByXAxis_Plane_3 = Dynamo_TORO.WIP_ROBARCH.alignByXAxis_Plane(sortPolar_Plane_3)

blockFrame_3 = CodeBlock()  # same code as blockFrame
drillFrame_3 = CodeBlock()  # same code as drillFrame

# group: Create drilling routine
createDrillRoutine3_3 = Dynamo_TORO.WIP_ROBARCH.createDrillRoutine3(directory_path_3, string_3, alignByXAxis_Plane_3, blockFrame_3, drillFrame_3)

# group: Reorient axes, here reversing and retaining the Z and X axes respectively.
flip_Plane_3 = Dynamo_TORO.WIP_ROBARCH.flip_Plane(planeAtParameter_3)

directory_path_4 = Directory("C:\Users\Nick Cote\Desktop\TORO\ClassLibrary1\ClassLibrary1\extra")
string_4 = StringInput("test03")
code_block_13 = CodeBlock()
# ---------- code_block_13.designscript (7 lines) ----------
val = 0..360..20;
CoordinateSystem.ByPlane(
 Plane.ByOriginNormalXAxis(
 Point.ByCoordinates(0,0,0),
 Vector.ByCoordinates(Math.Cos(val),0,Math.Sin(val)),
 Vector.ByCoordinates(0,1,0)
 ));
# ----------------------------------------

# group: Sample struts
origin_7 = CoordinateSystem.Origin(code_block_13.out1)
ZAxis_4 = CoordinateSystem.ZAxis(code_block_13.out1)
byStartPointDirectionLength_4 = Line.ByStartPointDirectionLength(startPoint=origin_7, direction=ZAxis_4)

code_block_14 = CodeBlock { CoordinateSystem.ByOrigin(0,0,0); }

# group: Sample node
origin_8 = CoordinateSystem.Origin(code_block_14)

# group: Get struts that intersect with node and orient to point as necessary.
getLinesAtPoint_4 = Dynamo_TORO.WIP_ROBARCH.getLinesAtPoint(byStartPointDirectionLength_4, origin_8)

planeAtParameter_4 = Curve.PlaneAtParameter(curve=getLinesAtPoint_4)
code_block_15 = CodeBlock { 120; }

# group: Check if planes are within drill cone.
testAngular_Plane_4 = Dynamo_TORO.WIP_ROBARCH.testAngular_Plane(planeAtParameter_4, arg2=code_block_15)

flatten_2 = Flatten(testAngular_Plane_4)
normal = Plane.Normal(flatten_2)
asPoint = Vector.AsPoint(normal)
pruneDuplicates = Point.PruneDuplicates(points=asPoint)
firstIndexOf = List.FirstIndexOf(list=asPoint, item=pruneDuplicates)
getItemAtIndex = List.GetItemAtIndex(list=flatten_2, index=firstIndexOf)
create_3 = List.Create(getItemAtIndex)
code_block_16 = CodeBlock { -4; }

# group: Sort planes by Z about average pole and shift values to best fit.
sortPolar2_Plane = Dynamo_TORO.WIP_ROBARCH.sortPolar2_Plane(create_3, code_block_16)

# group: Align planes to guide XAxis
alignByXAxis_Plane_4 = Dynamo_TORO.WIP_ROBARCH.alignByXAxis_Plane(sortPolar2_Plane)

blockFrame_4 = CodeBlock()  # same code as blockFrame
drillFrame_4 = CodeBlock()  # same code as drillFrame

# group: Create drilling routine
createDrillRoutine3_4 = Dynamo_TORO.WIP_ROBARCH.createDrillRoutine3(directory_path_4, string_4, alignByXAxis_Plane_4, blockFrame_4, drillFrame_4)

code_block_17 = CodeBlock { -90; }
rotate = Geometry.Rotate(drillFrame_4, drillFrame_4, code_block_17)

# group: Visualize the transformation
vis_transform = Dynamo_TORO.WIP_ROBARCH.vis_transform(alignByXAxis_Plane_4, blockFrame_4, rotate)

testAngular2_Plane = Dynamo_TORO.WIP_ROBARCH.testAngular2_Plane(alignByXAxis_Plane_2)
flatten_3 = Flatten(testAngular2_Plane)
origin_9 = Plane.Origin(flatten_3)
normal_2 = Plane.Normal(flatten_3)
reverse_2 = Vector.Reverse(normal_2)
code_block_18 = CodeBlock { 10; }
translate = Geometry.Translate(geometry=origin_9, direction=reverse_2, distance=code_block_18)
code_block_19 = CodeBlock { 100; }
byStartPointDirectionLength_5 = Line.ByStartPointDirectionLength(startPoint=translate, direction=reverse_2, length=code_block_19)
integer_slider = IntegerSlider(0, range=0..22 step 1)
code_block_20 = CodeBlock(item=byStartPointDirectionLength_5, i=integer_slider) { item[i]; }
number_slider = DoubleSlider(8, range=0..8 step 1)
vis_transform_2 = Dynamo_TORO.WIP_ROBARCH.vis_transform(alignByXAxis_Plane_2, blockFrame_2, drillFrame_2, arg4=number_slider)
directory_path_5 = Directory("C:\Users\Nick Cote\Desktop\TORO\ClassLibrary1\ClassLibrary1\extra")
string_5 = StringInput("test04")
code_block_21 = CodeBlock()
# ---------- code_block_21.designscript (7 lines) ----------
val = 0..360..20;
CoordinateSystem.ByPlane(
 Plane.ByOriginNormalXAxis(
 Point.ByCoordinates(0,0,0),
 Vector.ByCoordinates(0,Math.Cos(val),Math.Sin(val)),
 Vector.ByCoordinates(1,0,0)
 ));
# ----------------------------------------

# group: Sample struts
origin_10 = CoordinateSystem.Origin(code_block_21.out1)
ZAxis_5 = CoordinateSystem.ZAxis(code_block_21.out1)
byStartPointDirectionLength_6 = Line.ByStartPointDirectionLength(startPoint=origin_10, direction=ZAxis_5)

code_block_22 = CodeBlock { CoordinateSystem.ByOrigin(0,0,0); }

# group: Sample node
origin_11 = CoordinateSystem.Origin(code_block_22)

# group: Get struts that intersect with node and orient to point as necessary.
getLinesAtPoint_5 = Dynamo_TORO.WIP_ROBARCH.getLinesAtPoint(byStartPointDirectionLength_6, origin_11)

planeAtParameter_5 = Curve.PlaneAtParameter(curve=getLinesAtPoint_5)
code_block_23 = CodeBlock { 120; }

# group: Check if planes are within drill cone.
testAngular_Plane_5 = Dynamo_TORO.WIP_ROBARCH.testAngular_Plane(planeAtParameter_5, arg2=code_block_23)

flatten_4 = Flatten(testAngular_Plane_5)
normal_3 = Plane.Normal(flatten_4)
asPoint_2 = Vector.AsPoint(normal_3)
pruneDuplicates_2 = Point.PruneDuplicates(points=asPoint_2)
firstIndexOf_2 = List.FirstIndexOf(list=asPoint_2, item=pruneDuplicates_2)
getItemAtIndex_2 = List.GetItemAtIndex(list=flatten_4, index=firstIndexOf_2)
create_4 = List.Create(getItemAtIndex_2)
code_block_24 = CodeBlock { -4; }

# group: Sort planes by Z about average pole and shift values to best fit.
sortPolar2_Plane_2 = Dynamo_TORO.WIP_ROBARCH.sortPolar2_Plane(create_4, code_block_24)

# group: Align planes to guide XAxis
alignByXAxis_Plane_5 = Dynamo_TORO.WIP_ROBARCH.alignByXAxis_Plane(sortPolar2_Plane_2)

blockFrame_5 = CodeBlock()  # same code as blockFrame
drillFrame_5 = CodeBlock()  # same code as drillFrame

# group: Create drilling routine
createDrillRoutine3_5 = Dynamo_TORO.WIP_ROBARCH.createDrillRoutine3(directory_path_5, string_5, alignByXAxis_Plane_5, blockFrame_5, drillFrame_5)

code_block_25 = CodeBlock { -90; }
rotate_2 = Geometry.Rotate(drillFrame_5, drillFrame_5, code_block_25)
code_block_26 = CodeBlock {  }
code_block_27 = CodeBlock { 40; }
byLengths_2 = Cuboid.ByLengths(width=code_block_27, length=code_block_27, height=code_block_27)
edges = Topology.Edges(byLengths_2)
curveGeometry = Edge.CurveGeometry(edges)
translate_2 = Geometry.Translate(geometry=origin_9, direction=reverse_2, distance=code_block_19)
code_block_28 = CodeBlock { 3; }
byPointsRadius = Cylinder.ByPointsRadius(translate, translate_2, code_block_28)
number_slider_2 = DoubleSlider(0.5, range=0..1 step 0.1)
smartGetItem = Dynamo_TORO.WIP_ROBARCH.smartGetItem(byPointsRadius, number_slider_2)
number_slider_3 = DoubleSlider(2, range=0..22 step 1)
vis_transform2 = Dynamo_TORO.WIP_ROBARCH.vis_transform2(alignByXAxis_Plane_4, blockFrame_4, drillFrame_4, arg4=number_slider_3)
code_block_29 = CodeBlock(a=vis_transform2.out3) { a; }
