# Dynamo graph example01.dyn (Dynamo 0.9.0.3072)

code_block = CodeBlock { CoordinateSystem.ByOrigin(0,0,0); vals = 60..360..10; }
bySphericalCoordinates = Point.BySphericalCoordinates(code_block.out0, code_block.vals, code_block.vals, code_block.vals)
restOfItems = List.RestOfItems(bySphericalCoordinates)
flatten = Flatten(restOfItems)
code_block_2 = CodeBlock { Point.ByCoordinates(0,-100,-100); Vector.ByCoordinates(-0.1,-0.3,0.2); 45; }
rotate = Geometry.Rotate(geometry=restOfItems, origin=code_block_2.out0, axis=code_block_2.out1, degrees=code_block_2.out2, lacing=CrossProduct)
code_block_3 = CodeBlock { 1.3; }
scale = Geometry.Scale(geometry=rotate, xamount=code_block_3, yamount=code_block_3, zamount=code_block_3)
flatten_2 = Flatten(scale)
byTwoPoints = Vector.ByTwoPoints(start=flatten, end=flatten_2)
length = Vector.Length(byTwoPoints)
code_block_4 = CodeBlock(x=length) { x/2; }
translate = Geometry.Translate(geometry=flatten, direction=byTwoPoints, distance=code_block_4)
ZAxis = Vector.ZAxis()
cross = Vector.Cross(vector=byTwoPoints, cross=ZAxis)
code_block_5 = CodeBlock { 220; }
translate_2 = Geometry.Translate(geometry=translate, direction=cross, distance=code_block_5)
byPoints = PolyCurve.ByPoints(points=flatten)
byPoints_2 = PolyCurve.ByPoints(points=flatten_2)
