# Dynamo graph ArcPavDesigns.dyn (Dynamo 0.9.1.4062)

number = DoubleInput(1000)
code_block = CodeBlock { -3000; }
byCoordinates = Point.ByCoordinates(x=number, y=code_block)
byCoordinates_2 = Point.ByCoordinates(y=code_block)
byStartPointEndPoint = Line.ByStartPointEndPoint(startPoint=byCoordinates, endPoint=byCoordinates_2)
code_block_2 = CodeBlock { 2000; }
translate = Geometry.Translate(geometry=byStartPointEndPoint, yTranslation=code_block_2)
code_block_3 = CodeBlock { 200; 500; }
translate_2 = Geometry.Translate(geometry=translate, yTranslation=code_block_3.out0, zTranslation=code_block_3.out1)
code_block_4 = CodeBlock { 200; 400; }
translate_3 = Geometry.Translate(geometry=translate_2, yTranslation=code_block_4.out1, zTranslation=code_block_4.out0)
create = List.Create(byStartPointEndPoint, translate, translate_2, translate_3)
byLoft = Surface.ByLoft(create)
code_block_5 = CodeBlock { 5; }
code_block_6 = CodeBlock { 100; }
lunchbox_space_truss_structure = Custom[LunchBox Space Truss Structure](Surface=byLoft, U=code_block_5, V=code_block_5, Depth=code_block_6)  # Create a space truss using a surface.
code_block_7 = CodeBlock(topedgesX=lunchbox_space_truss_structure.CenterlinesA) { topedgesX; }
code_block_8 = CodeBlock(topedgesY=lunchbox_space_truss_structure.CenterlinesB) { topedgesY; }
code_block_9 = CodeBlock(diagonals=lunchbox_space_truss_structure.CenterlinesE) { diagonals; }
code_block_10 = CodeBlock(x=code_block_7, y=code_block_8, z=code_block_9) { {x,y,z}; }
flatten = Flatten(code_block_10)
startPoint = Curve.StartPoint(flatten)
endPoint = Curve.EndPoint(flatten)
join = List.Join(startPoint, endPoint)
code_block_11 = CodeBlock { 6; }
code_block_12 = CodeBlock { 20; }
byLengths = Cuboid.ByLengths(width=code_block_12, length=code_block_12, height=code_block_12)
averageStrutsVector = WireFrameToRobot.OrientationStrategy.AverageStrutsVector()
byPointsLinesAndGeoOrientationStrategy = WireFrameToRobot.Node.ByPointsLinesAndGeoOrientationStrategy(join, flatten, code_block_11, byLengths, averageStrutsVector)
create_2 = List.Create(byStartPointEndPoint, translate)
code_block_13 = CodeBlock { -2000; }
translate_4 = Geometry.Translate(geometry=create_2, xTranslation=code_block_13)
byLoft_2 = Surface.ByLoft(translate_4)
code_block_14 = CodeBlock(a=translate_4) { a[1]; }
endPoint_2 = Curve.EndPoint(code_block_14)
code_block_15 = CodeBlock { 300; }
translate_5 = Geometry.Translate(geometry=endPoint_2, yTranslation=code_block_15, zTranslation=code_block_15)
YAxis = Vector.YAxis()
byStartPointEndPointStartTangent = Arc.ByStartPointEndPointStartTangent(endPoint_2, translate_5, YAxis)
extrude = Curve.Extrude(curve=byStartPointEndPointStartTangent, distance=number)
translate_6 = Geometry.Translate(geometry=translate_5, yTranslation=code_block_15, zTranslation=code_block_15)
code_block_16 = CodeBlock { 1; }
coordinateSystemAtParameter = Curve.CoordinateSystemAtParameter(byStartPointEndPointStartTangent, code_block_16)
YAxis_2 = CoordinateSystem.YAxis(coordinateSystemAtParameter)
byStartPointEndPointStartTangent_2 = Arc.ByStartPointEndPointStartTangent(translate_5, translate_6, YAxis_2)
code_block_17 = CodeBlock(x=number) { x*-1; }
extrude_2 = Curve.Extrude(curve=byStartPointEndPointStartTangent_2, distance=code_block_17)
flipNormalDirection = Surface.FlipNormalDirection(extrude_2)
create_3 = List.Create(byLoft_2, extrude, flipNormalDirection)
code_block_18 = CodeBlock { 3; }
code_block_19 = CodeBlock { 100; }
lunchbox_space_truss_structure_2 = Custom[LunchBox Space Truss Structure](Surface=create_3, U=code_block_18, V=code_block_18, Depth=code_block_19)
code_block_20 = CodeBlock(topedgesX=lunchbox_space_truss_structure_2.CenterlinesA) { topedgesX; }
code_block_21 = CodeBlock(topedgesY=lunchbox_space_truss_structure_2.CenterlinesB) { topedgesY; }
code_block_22 = CodeBlock(diagonals=lunchbox_space_truss_structure_2.CenterlinesE) { diagonals; }
code_block_23 = CodeBlock(x=code_block_20, y=code_block_21, z=code_block_22) { {x,y,z}; }
flatten_2 = Flatten(code_block_23)
startPoint_2 = Curve.StartPoint(flatten_2)
endPoint_3 = Curve.EndPoint(flatten_2)
join_2 = List.Join(startPoint_2, endPoint_3)
code_block_24 = CodeBlock { 6; }
code_block_25 = CodeBlock { 20; }
byLengths_2 = Cuboid.ByLengths(width=code_block_25, length=code_block_25, height=code_block_25)
averageStrutsVector_2 = WireFrameToRobot.OrientationStrategy.AverageStrutsVector()
byPointsLinesAndGeoOrientationStrategy_2 = WireFrameToRobot.Node.ByPointsLinesAndGeoOrientationStrategy(join_2, flatten_2, code_block_24, byLengths_2, averageStrutsVector_2)
findUniqueStruts = WireFrameToRobot.Node.FindUniqueStruts(byPointsLinesAndGeoOrientationStrategy_2)
totalStrutLength = WireFrameToRobot.Node.TotalStrutLength(byPointsLinesAndGeoOrientationStrategy_2)
orientedNodeGeometry = WireFrameToRobot.Node.OrientedNodeGeometry()
byUnion = Solid.ByUnion(orientedNodeGeometry)
byGeometry = BoundingBox.ByGeometry(byUnion)
toCuboid = BoundingBox.ToCuboid()
