# Dynamo graph BasicExamples.dyn (Dynamo 1.1.0.2094)

base_rectangle = CodeBlock()
# ---------- base_rectangle.designscript (3 lines) ----------
c = CoordinateSystem.ByOrigin(1000,0,140);
cs = CoordinateSystem.Rotate(c,Point.Origin(),Vector.ZAxis(),120);
Rectangle.ByWidthLength(cs,390,590);
# ----------------------------------------
origin = Plane.Origin(base_rectangle.cs)
code_block = CodeBlock { 25..300..#7; }
byCenterPointRadius = Circle.ByCenterPointRadius(centerPoint=origin, radius=code_block)
code_block_2 = CodeBlock(c=byCenterPointRadius) { 0..1..#Math.Ceiling(c.Length/20); }
pointAtParameter = Curve.PointAtParameter(curve=byCenterPointRadius, param=code_block_2)

# group: create planes from points
code_block_3 = CodeBlock { Vector.ByCoordinates(0,0,-1); }
byOriginNormal = Plane.ByOriginNormal(origin=pointAtParameter, normal=code_block_3)

# group: create targets and split into 3 lists
robTargetAtPlane = Dynamo_TORO.DataTypes.RobTargetAtPlane(byOriginNormal)
listFistLast = Dynamo_TORO.Utilities.ListFistLast(robTargetAtPlane)

code_block_4 = CodeBlock { 150; "MyTool"; "WObj1"; }
code_block_5 = CodeBlock { "DO10_1"; 1; 0; }

# group: this adds a unique name for each target
code_block_6 = CodeBlock { "ftp"; }
python_script = Python(IN[0]=listFistLast.out1, IN[1]=code_block_6)
# ---------- python_script.python (16 lines) ----------
import clr
clr.AddReference('ProtoGeometry')
from Autodesk.DesignScript.Geometry import *
#The inputs to this node will be stored as a list in the IN variables.
dataEnteringNode = IN

ct = len(IN[0])
st = IN[1]

strComb = []

for i in range(0,ct):
	strComb.append(st+str(i)+'t')	

#Assign your output to the OUT variable.
OUT = strComb
# ----------------------------------------
code_block_7 = CodeBlock { "mtp"; }
python_script_2 = Python(IN[0]=listFistLast.out1, IN[1]=code_block_7)  # same code as python_script
code_block_8 = CodeBlock { "etp"; }
python_script_3 = Python(IN[0]=listFistLast.out1, IN[1]=code_block_8)  # same code as python_script

moveLDO = Dynamo_TORO.Instructions.MoveLDO(listFistLast.out0, code_block_4.out0, code_block_5.out0, code_block_5.out1, arg5=python_script, arg6=code_block_4.out1, arg7=code_block_4.out2)
moveL = Dynamo_TORO.Instructions.MoveL(listFistLast.out1, code_block_4.out0, arg3=python_script_2, arg4=code_block_4.out1, arg5=code_block_4.out2)
moveLDO_2 = Dynamo_TORO.Instructions.MoveLDO(listFistLast.out2, code_block_4.out0, code_block_5.out0, code_block_5.out2, arg5=python_script_3, arg6=code_block_4.out1, arg7=code_block_4.out2)

# group: combine the 3 move back to 1 set
insertAtFirstLast = Dynamo_TORO.Utilities.InsertAtFirstLast(moveLDO.out0, moveL.out0, moveLDO_2.out0)
flatten = Flatten(insertAtFirstLast)
insertAtFirstLast_2 = Dynamo_TORO.Utilities.InsertAtFirstLast(moveLDO.out1, moveL.out1, moveLDO_2.out1)
flatten_2 = Flatten(insertAtFirstLast_2)

# group: insert the command to start the fan at the begining then stop it at the end
turn_fan_on_off = CodeBlock { "Set DO10_2"; "Reset DO10_2"; }
addItemToFront = List.AddItemToFront(item=turn_fan_on_off.out0, list=flatten_2)
addItemToEnd = List.AddItemToEnd(item=turn_fan_on_off.out1, list=addItemToFront)

# group: tool and work objects
code_block_9 = CodeBlock()
# ---------- code_block_9.designscript (3 lines) ----------
point1 = Point.ByCoordinates(0,0,101.6+50);
vector1 = Vector.ByCoordinates(0, 0, 1);
plane1 = Plane.ByOriginNormal(point1, vector1);
# ----------------------------------------
toolAtPlane = Dynamo_TORO.DataTypes.ToolAtPlane(code_block_9.plane1, arg2=code_block_4.out1)
XY = Plane.XY()
wobjAtPlane = Dynamo_TORO.DataTypes.WobjAtPlane(XY, code_block_4.out2)
code_block_10 = CodeBlock { point1 = Point.Origin(); vector1 = Vector.ByCoordinates(0, 0, 1); plane1 = Plane.ByOriginNormal(point1, vector1); }

ABB_RemotePendant = AbbRemotePendant(flatten, addItemToEnd, toolAtPlane, wobjAtPlane)
notes = CodeBlock()
# ---------- notes.designscript (7 lines) ----------
/*
1.this set creates the MoveDO at the start of the curve which urns the laser on
2.Then does a regular MoveL for all the targets on the curve
3.Then add another MoveLDO at the end
you can do this to splice in different moves

*/;
# ----------------------------------------
