# Dynamo graph CoolingTowerPavilionFindNodeTyoes.dyn (Dynamo 0.9.1.4062)

file_path = Filename("C:\Users\Mike\Desktop\au2015sat.sat")
importFromSAT = Geometry.ImportFromSAT(file_path)
code_block = CodeBlock { 888; }
scale = Geometry.Scale(geometry=importFromSAT, amount=code_block)
byGeometry = BoundingBox.ByGeometry(scale)
toCuboid = BoundingBox.ToCuboid(byGeometry)
code_block_2 = CodeBlock { 10; }
code_block_3 = CodeBlock { 1000; }
code_block_4 = CodeBlock(base=code_block_3) { baseh = base; bottomRing = 0; midh = baseh + base; toph = midh +baseh; }
byCoordinates = Point.ByCoordinates(x=code_block_2, y=code_block_2, z=code_block_4.bottomRing)
code_block_5 = CodeBlock(base=code_block_3) { bottomRing = base * 1.5; mid = base / 1.2; top = mid * 1.1; }
byCenterPointRadius = Circle.ByCenterPointRadius(centerPoint=byCoordinates, radius=code_block_5.bottomRing)
byCoordinates_2 = Point.ByCoordinates(x=code_block_2, y=code_block_2, z=code_block_4.baseh)
byCenterPointRadius_2 = Circle.ByCenterPointRadius(centerPoint=byCoordinates_2, radius=code_block_3)
byCoordinates_3 = Point.ByCoordinates(x=code_block_2, y=code_block_2, z=code_block_4.midh)
byCenterPointRadius_3 = Circle.ByCenterPointRadius(centerPoint=byCoordinates_3, radius=code_block_5.mid)
byCoordinates_4 = Point.ByCoordinates(x=code_block_2, y=code_block_2, z=code_block_4.toph)
byCenterPointRadius_4 = Circle.ByCenterPointRadius(centerPoint=byCoordinates_4, radius=code_block_5.top)
create = List.Create(byCenterPointRadius, byCenterPointRadius_2, byCenterPointRadius_3, byCenterPointRadius_4)
byLoft = Surface.ByLoft(create)
boundingBox = Geometry.BoundingBox(byLoft)
toCuboid_2 = BoundingBox.ToCuboid(boundingBox)
averageStrutsVector = WireFrameToRobot.OrientationStrategy.AverageStrutsVector()
code_block_6 = CodeBlock { 20; }
lunchbox_triangle_grid_by_face = Custom[LunchBox Triangle Grid by Face](Surface=byLoft, U=code_block_6, V=code_block_6)  # Create a Triangular XYZ grid on a face. The face surface must have an untrimmed UV parameter space.
code_block_7 = CodeBlock(lines=lunchbox_triangle_grid_by_face.Panel_Polys) { lines; }
explode = Geometry.Explode(code_block_7)
flatten = Flatten(explode)
startPoint = Curve.StartPoint(flatten)
endPoint = Curve.EndPoint(flatten)
byStartPointEndPoint = Line.ByStartPointEndPoint(startPoint=startPoint, endPoint=endPoint)
code_block_8 = CodeBlock { 6; }
code_block_9 = CodeBlock { 20; }
byLengths = Cuboid.ByLengths(width=code_block_9, length=code_block_9, height=code_block_9)
averageStrutsVector_2 = WireFrameToRobot.OrientationStrategy.AverageStrutsVector()
byPointsLinesAndGeoOrientationStrategy = WireFrameToRobot.Node.ByPointsLinesAndGeoOrientationStrategy(startPoint, byStartPointEndPoint, code_block_8, byLengths, averageStrutsVector_2)
findNodeTypesUsingHash = WireFrameToRobot.Node.FindNodeTypesUsingHash(byPointsLinesAndGeoOrientationStrategy)
code_block_10 = CodeBlock(a=findNodeTypesUsingHash) { a[0..10]; }
orientedNodeGeometry = WireFrameToRobot.Node.OrientedNodeGeometry(code_block_10)
struts = WireFrameToRobot.Node.Struts(findNodeTypesUsingHash)
lineRepresentation = WireFrameToRobot.Strut.LineRepresentation(struts)
findUniqueStruts = WireFrameToRobot.Node.FindUniqueStruts(byPointsLinesAndGeoOrientationStrategy)
struts_2 = WireFrameToRobot.Node.Struts(byPointsLinesAndGeoOrientationStrategy)
ID = WireFrameToRobot.Strut.ID(struts_2)
