# Dynamo graph CoolingTowerPavilionFindNodeTypesCommentedCheckStrategies.dyn (Dynamo 0.9.0.3067)

# group: Scale Factor For Diameters
code_block = CodeBlock { 0.8; }

# group: Create the cooling tower form
code_block_2 = CodeBlock { 1200; }
code_block_3 = CodeBlock(base=code_block_2) { baseh = base; bottomRing = 0; midh = baseh + base; toph = midh +baseh; }
code_block_4 = CodeBlock(base=code_block_2) { bottomRing = base * 1.5; mid = base / 1.2; top = mid * 1.1; }

create = List.Create(code_block_3.bottomRing, code_block_3.baseh, code_block_3.midh, code_block_3.toph)
byCoordinates = Point.ByCoordinates(z=create)
create_2 = List.Create(code_block_4.bottomRing, code_block_2, code_block_4.mid, code_block_4.top)

# group (continued): Create the cooling tower form
code_block_5 = CodeBlock(x=create_2, diameterScaleFactor=code_block) { x*diameterScaleFactor; }

byCenterPointRadius = Circle.ByCenterPointRadius(centerPoint=byCoordinates, radius=code_block_5)

# group (continued): Create the cooling tower form
byLoft = Surface.ByLoft(byCenterPointRadius)

# group: Bounds Info
boundingBox = Geometry.BoundingBox(byLoft)
toCuboid = BoundingBox.ToCuboid(boundingBox)

# group: Inputs for Node Strut Model
averageStrutsVector = WireFrameToRobot.OrientationStrategy.AverageStrutsVector()
code_block_6 = CodeBlock { 6; }
code_block_7 = CodeBlock { 20; }
byLengths = Cuboid.ByLengths(width=code_block_7, length=code_block_7, height=code_block_7)

# group: Tessellate
code_block_8 = CodeBlock { 8; }
code_block_9 = CodeBlock { 8; }
lunchbox_triangle_grid_by_face = Custom[LunchBox Triangle Grid by Face](Surface=byLoft, U=code_block_8, V=code_block_9)  # Create a Triangular XYZ grid on a face. The face surface must have an untrimmed UV parameter space.

# group: Get All Lines and Points that represent the form - There are duplicates in this list
code_block_10 = CodeBlock(lines=lunchbox_triangle_grid_by_face.Panel_Polys) { lines; }
explode = Geometry.Explode(code_block_10)
flatten = Flatten(explode)
startPoint = Curve.StartPoint(flatten)
endPoint = Curve.EndPoint(flatten)
byStartPointEndPoint = Line.ByStartPointEndPoint(startPoint=startPoint, endPoint=endPoint)

averageStrutsAlignToStrut = WireFrameToRobot.OrientationStrategy.AverageStrutsAlignToStrut()
byPointsLinesAndGeoOrientationStrategy = WireFrameToRobot.Node.ByPointsLinesAndGeoOrientationStrategy(startPoint, byStartPointEndPoint, code_block_6, byLengths, averageStrutsAlignToStrut)
file_path = Filename("No file selected.")
exportToSAT = Geometry.ExportToSAT(byLoft, file_path)
findUniqueStruts = WireFrameToRobot.Node.FindUniqueStruts(byPointsLinesAndGeoOrientationStrategy)

# group: Guessing These are the outputs Gustav Cares about for React
center = WireFrameToRobot.Node.Center(byPointsLinesAndGeoOrientationStrategy)
lineRepresentation = WireFrameToRobot.Strut.LineRepresentation(findUniqueStruts)

length = Curve.Length(lineRepresentation)
findNodeTypesUsingHash = WireFrameToRobot.Node.FindNodeTypesUsingHash(byPointsLinesAndGeoOrientationStrategy)

# group: Design Metrics
maximumItem = List.MaximumItem(length)
totalStrutLength = WireFrameToRobot.Node.TotalStrutLength(byPointsLinesAndGeoOrientationStrategy)
count = Count(findNodeTypesUsingHash)
count_2 = Count(byPointsLinesAndGeoOrientationStrategy)

# group: For Nick: These are the aligned Cut Planes (disconnected because this takes a minute to run)
struts = WireFrameToRobot.Node.Struts()
alignedCutPlaneAtOrigin = WireFrameToRobot.Strut.AlignedCutPlaneAtOrigin(struts)
alignedCoordinateSystemAtOrigin = WireFrameToRobot.Strut.AlignedCoordinateSystemAtOrigin(struts)

averageStrutsAlignToZExactly = WireFrameToRobot.OrientationStrategy.AverageStrutsAlignToZExactly()
holderRep = WireFrameToRobot.Node.holderRep(byPointsLinesAndGeoOrientationStrategy)
averageStrutsVector_2 = WireFrameToRobot.OrientationStrategy.AverageStrutsVector()
averageStrutsFindTypes = WireFrameToRobot.OrientationStrategy.AverageStrutsFindTypes()
