# Dynamo graph SurfacePavDesigns.dyn (Dynamo 0.9.1.4062)

code_block = CodeBlock { Autodesk.Point.ByCoordinates(0,20,0); Autodesk.Point.ByCoordinates(0,23,5); Autodesk.Point.ByCoordinates(0,20,15); }
byThreePoints = Arc.ByThreePoints(firstPoint=code_block.out0, secondPoint=code_block.out1, thirdPoint=code_block.out2)
code_block_2 = CodeBlock { Autodesk.Point.ByCoordinates(0,20,15); Autodesk.Point.ByCoordinates(0,15,20); Autodesk.Point.ByCoordinates(0,17,25); }
byThreePoints_2 = Arc.ByThreePoints(firstPoint=code_block_2.out0, secondPoint=code_block_2.out1, thirdPoint=code_block_2.out2)
code_block_3 = CodeBlock(a=byThreePoints, b=byThreePoints_2) { {a,b}; }
code_block_4 = CodeBlock { 0..1..#6; }
pointAtParameter = Curve.PointAtParameter(curve=code_block_3, param=code_block_4, lacing=CrossProduct)
flatten = Flatten(pointAtParameter)
byPoints = NurbsCurve.ByPoints(flatten)
code_block_5 = CodeBlock { 360; }
byRevolve = Surface.ByRevolve(byPoints, arg4=code_block_5)
code_block_6 = CodeBlock { 10; }
scale = Geometry.Scale(geometry=byRevolve, amount=code_block_6)
XY = Plane.XY()
mirror = Geometry.Mirror(geometry=scale, mirrorPlane=XY)
code_block_7 = CodeBlock { 5; }
lunchbox_quad_grid_by_face = Custom[LunchBox Quad Grid by Face](Surface=mirror, U=code_block_7, V=code_block_7)  # Create a quadrangular XYZ grid on a face. The face surface must have an untrimmed UV parameter space.
code_block_8 = CodeBlock { 4; }
generateSide = Custom[generateSide](divisions=code_block_8, Verticaldivisions=code_block_8)  # test
code_block_9 = CodeBlock { -35; }
rotateAndTranslate = Custom[rotateAndTranslate](geometry=generateSide.PolyCurve, xTranslation=generateSide.x_translation, oldgeometry=generateSide.PolyCurve, divisions=code_block_8, Verticaldivisions=code_block_8, angle=code_block_9)  # rotate a parallelgram and translate
rotateAndTranslate_2 = Custom[rotateAndTranslate](geometry=rotateAndTranslate.Geometry, xTranslation=generateSide.x_translation, oldgeometry=generateSide.PolyCurve, divisions=code_block_8, Verticaldivisions=code_block_8, angle=code_block_9)
rotateAndTranslate_3 = Custom[rotateAndTranslate](geometry=rotateAndTranslate_2.Geometry, xTranslation=generateSide.x_translation, oldgeometry=generateSide.PolyCurve, divisions=code_block_8, Verticaldivisions=code_block_8, angle=code_block_9)
rotateAndTranslate_4 = Custom[rotateAndTranslate](geometry=rotateAndTranslate_3.Geometry, xTranslation=generateSide.x_translation, oldgeometry=generateSide.PolyCurve, divisions=code_block_8, Verticaldivisions=code_block_8, angle=code_block_9)
rotateAndTranslate_5 = Custom[rotateAndTranslate](geometry=rotateAndTranslate_4.Geometry, xTranslation=generateSide.x_translation, oldgeometry=generateSide.PolyCurve, divisions=code_block_8, Verticaldivisions=code_block_8, angle=code_block_9)
rotateAndTranslate_6 = Custom[rotateAndTranslate](geometry=rotateAndTranslate_5.Geometry, xTranslation=generateSide.x_translation, oldgeometry=generateSide.PolyCurve, divisions=code_block_8, Verticaldivisions=code_block_8, angle=code_block_9)
rotateAndTranslate_7 = Custom[rotateAndTranslate](geometry=rotateAndTranslate_6.Geometry, xTranslation=generateSide.x_translation, oldgeometry=generateSide.PolyCurve, divisions=code_block_8, Verticaldivisions=code_block_8, angle=code_block_9)
rotateAndTranslate_8 = Custom[rotateAndTranslate](geometry=rotateAndTranslate_7.Geometry, xTranslation=generateSide.x_translation, oldgeometry=generateSide.PolyCurve, divisions=code_block_8, Verticaldivisions=code_block_8, angle=code_block_9)
rotateAndTranslate_9 = Custom[rotateAndTranslate](geometry=rotateAndTranslate_8.Geometry, xTranslation=generateSide.x_translation, oldgeometry=generateSide.PolyCurve, divisions=code_block_8, Verticaldivisions=code_block_8, angle=code_block_9)
create = List.Create(generateSide.PolyCurve, rotateAndTranslate.Geometry, rotateAndTranslate_2.Geometry, rotateAndTranslate_3.Geometry, rotateAndTranslate_4.Geometry, rotateAndTranslate.lines, rotateAndTranslate_2.lines, rotateAndTranslate_3.lines, rotateAndTranslate_4.lines, rotateAndTranslate_5.lines, rotateAndTranslate_6.Geometry, rotateAndTranslate_6.lines, rotateAndTranslate_7.Geometry, rotateAndTranslate_7.lines, rotateAndTranslate_8.Geometry, rotateAndTranslate_8.lines, rotateAndTranslate_9.Geometry, rotateAndTranslate_9.lines, generateSide.lines)
flatten_2 = Flatten(create)
code_block_10 = CodeBlock(lines=flatten_2) { lines; }
explode = Geometry.Explode(code_block_10)
flatten_3 = Flatten(explode)
startPoint = Curve.StartPoint(flatten_3)
endPoint = Curve.EndPoint(flatten_3)
byStartPointEndPoint = Line.ByStartPointEndPoint(startPoint=startPoint, endPoint=endPoint)
code_block_11 = CodeBlock { 6; }
code_block_12 = CodeBlock { 20; }
byLengths = Cuboid.ByLengths(width=code_block_12, length=code_block_12, height=code_block_12)
averageStrutsVector = WireFrameToRobot.OrientationStrategy.AverageStrutsVector()
byPointsLinesAndGeoOrientationStrategy = WireFrameToRobot.Node.ByPointsLinesAndGeoOrientationStrategy(startPoint, byStartPointEndPoint, code_block_11, byLengths, averageStrutsVector)
lunchbox_triangle_grid_by_face = Custom[LunchBox Triangle Grid by Face](Surface=mirror, U=code_block_7, V=code_block_7)  # Create a Triangular XYZ grid on a face. The face surface must have an untrimmed UV parameter space.
code_block_13 = CodeBlock(lines=lunchbox_triangle_grid_by_face.Panel_Polys) { lines; }
explode_2 = Geometry.Explode(code_block_13)
flatten_4 = Flatten(explode_2)
startPoint_2 = Curve.StartPoint(flatten_4)
endPoint_2 = Curve.EndPoint(flatten_4)
byStartPointEndPoint_2 = Line.ByStartPointEndPoint(startPoint=startPoint_2, endPoint=endPoint_2)
code_block_14 = CodeBlock { 6; }
code_block_15 = CodeBlock { 20; }
byLengths_2 = Cuboid.ByLengths(width=code_block_15, length=code_block_15, height=code_block_15)
averageStrutsVector_2 = WireFrameToRobot.OrientationStrategy.AverageStrutsVector()
byPointsLinesAndGeoOrientationStrategy_2 = WireFrameToRobot.Node.ByPointsLinesAndGeoOrientationStrategy(startPoint_2, byStartPointEndPoint_2, code_block_14, byLengths_2, averageStrutsVector_2)
findUniqueStruts = WireFrameToRobot.Node.FindUniqueStruts(byPointsLinesAndGeoOrientationStrategy_2)
lineRepresentation = WireFrameToRobot.Strut.LineRepresentation(findUniqueStruts)
length = Curve.Length(lineRepresentation)
maximumItem = List.MaximumItem(length)
orientedNodeGeometry = WireFrameToRobot.Node.OrientedNodeGeometry(byPointsLinesAndGeoOrientationStrategy_2)
struts = WireFrameToRobot.Node.Struts(byPointsLinesAndGeoOrientationStrategy_2)
strutGeometry = WireFrameToRobot.Strut.StrutGeometry(struts)
