# Dynamo graph coolingTower.dyn (Dynamo 0.9.1.4062)

code_block = CodeBlock { 1200; }
code_block_2 = CodeBlock(base=code_block) { baseh = base; bottomRing = 0; midh = baseh + base; toph = midh +baseh; }
byCoordinates = Point.ByCoordinates(z=code_block_2.bottomRing)
code_block_3 = CodeBlock(base=code_block) { bottomRing = base * 1.5; mid = base / 1.2; top = mid * 1.1; }
byCenterPointRadius = Circle.ByCenterPointRadius(centerPoint=byCoordinates, radius=code_block_3.bottomRing)
byCoordinates_2 = Point.ByCoordinates(z=code_block_2.baseh)
byCenterPointRadius_2 = Circle.ByCenterPointRadius(centerPoint=byCoordinates_2, radius=code_block)
byCoordinates_3 = Point.ByCoordinates(z=code_block_2.midh)
byCenterPointRadius_3 = Circle.ByCenterPointRadius(centerPoint=byCoordinates_3, radius=code_block_3.mid)
byCoordinates_4 = Point.ByCoordinates(z=code_block_2.toph)
byCenterPointRadius_4 = Circle.ByCenterPointRadius(centerPoint=byCoordinates_4, radius=code_block_3.top)
create = List.Create(byCenterPointRadius, byCenterPointRadius_2, byCenterPointRadius_3, byCenterPointRadius_4)
byLoft = Surface.ByLoft(create)
boundingBox = Geometry.BoundingBox(byLoft)
toCuboid = BoundingBox.ToCuboid(boundingBox)
