# Dynamo graph pavDesigns12dyn.dyn (Dynamo 0.9.1.4062)

number = DoubleInput(1000)
code_block = CodeBlock { -3000; }
byCoordinates = Point.ByCoordinates(x=number, y=code_block)
byCoordinates_2 = Point.ByCoordinates(y=code_block)
byStartPointEndPoint = Line.ByStartPointEndPoint(startPoint=byCoordinates, endPoint=byCoordinates_2)
code_block_2 = CodeBlock { 2000; }
translate = Geometry.Translate(geometry=byStartPointEndPoint, yTranslation=code_block_2)
code_block_3 = CodeBlock { 200; 500; }
translate_2 = Geometry.Translate(geometry=translate, yTranslation=code_block_3.out0, zTranslation=code_block_3.out1)
code_block_4 = CodeBlock { 200; 400; }
translate_3 = Geometry.Translate(geometry=translate_2, yTranslation=code_block_4.out1, zTranslation=code_block_4.out0)
create = List.Create(byStartPointEndPoint, translate, translate_2, translate_3)
byLoft = Surface.ByLoft(create)
code_block_5 = CodeBlock { 5; }
code_block_6 = CodeBlock { 100; }
lunchbox_space_truss_structure = Custom[LunchBox Space Truss Structure](Surface=byLoft, U=code_block_5, V=code_block_5, Depth=code_block_6)  # Create a space truss using a surface.
code_block_7 = CodeBlock(topedgesX=lunchbox_space_truss_structure.CenterlinesA) { topedgesX; }
code_block_8 = CodeBlock(topedgesY=lunchbox_space_truss_structure.CenterlinesB) { topedgesY; }
code_block_9 = CodeBlock(diagonals=lunchbox_space_truss_structure.CenterlinesE) { diagonals; }
create_2 = List.Create(byStartPointEndPoint, translate)
code_block_10 = CodeBlock { -2000; }
translate_4 = Geometry.Translate(geometry=create_2, xTranslation=code_block_10)
byLoft_2 = Surface.ByLoft(translate_4)
code_block_11 = CodeBlock(a=translate_4) { a[1]; }
endPoint = Curve.EndPoint(code_block_11)
code_block_12 = CodeBlock { 300; }
translate_5 = Geometry.Translate(geometry=endPoint, yTranslation=code_block_12, zTranslation=code_block_12)
YAxis = Vector.YAxis()
byStartPointEndPointStartTangent = Arc.ByStartPointEndPointStartTangent(endPoint, translate_5, YAxis)
extrude = Curve.Extrude(curve=byStartPointEndPointStartTangent, distance=number)
translate_6 = Geometry.Translate(geometry=translate_5, yTranslation=code_block_12, zTranslation=code_block_12)
code_block_13 = CodeBlock { 1; }
coordinateSystemAtParameter = Curve.CoordinateSystemAtParameter(byStartPointEndPointStartTangent, code_block_13)
YAxis_2 = CoordinateSystem.YAxis(coordinateSystemAtParameter)
byStartPointEndPointStartTangent_2 = Arc.ByStartPointEndPointStartTangent(translate_5, translate_6, YAxis_2)
code_block_14 = CodeBlock(x=number) { x*-1; }
extrude_2 = Curve.Extrude(curve=byStartPointEndPointStartTangent_2, distance=code_block_14)
flipNormalDirection = Surface.FlipNormalDirection(extrude_2)
create_3 = List.Create(byLoft_2, extrude, flipNormalDirection)
code_block_15 = CodeBlock { 3; }
code_block_16 = CodeBlock { 100; }
lunchbox_space_truss_structure_2 = Custom[LunchBox Space Truss Structure](Surface=create_3, U=code_block_15, V=code_block_15, Depth=code_block_16)
code_block_17 = CodeBlock(diagonals=lunchbox_space_truss_structure_2.CenterlinesE) { diagonals; }
code_block_18 = CodeBlock(topedgesY=lunchbox_space_truss_structure_2.CenterlinesB) { topedgesY; }
code_block_19 = CodeBlock(topedgesX=lunchbox_space_truss_structure_2.CenterlinesA) { topedgesX; }
code_block_20 = CodeBlock { 4; }
generateSide = Custom[generateSide](divisions=code_block_20, Verticaldivisions=code_block_20)  # test
code_block_21 = CodeBlock { -35; }
rotateAndTranslate = Custom[rotateAndTranslate](geometry=generateSide.PolyCurve, xTranslation=generateSide.x_translation, oldgeometry=generateSide.PolyCurve, divisions=code_block_20, Verticaldivisions=code_block_20, angle=code_block_21)  # rotate a parallelgram and translate
rotateAndTranslate_2 = Custom[rotateAndTranslate](geometry=rotateAndTranslate.Geometry, xTranslation=generateSide.x_translation, oldgeometry=generateSide.PolyCurve, divisions=code_block_20, Verticaldivisions=code_block_20, angle=code_block_21)
rotateAndTranslate_3 = Custom[rotateAndTranslate](geometry=rotateAndTranslate_2.Geometry, xTranslation=generateSide.x_translation, oldgeometry=generateSide.PolyCurve, divisions=code_block_20, Verticaldivisions=code_block_20, angle=code_block_21)
rotateAndTranslate_4 = Custom[rotateAndTranslate](geometry=rotateAndTranslate_3.Geometry, xTranslation=generateSide.x_translation, oldgeometry=generateSide.PolyCurve, divisions=code_block_20, Verticaldivisions=code_block_20, angle=code_block_21)
rotateAndTranslate_5 = Custom[rotateAndTranslate](geometry=rotateAndTranslate_4.Geometry, xTranslation=generateSide.x_translation, oldgeometry=generateSide.PolyCurve, divisions=code_block_20, Verticaldivisions=code_block_20, angle=code_block_21)
rotateAndTranslate_6 = Custom[rotateAndTranslate](geometry=rotateAndTranslate_5.Geometry, xTranslation=generateSide.x_translation, oldgeometry=generateSide.PolyCurve, divisions=code_block_20, Verticaldivisions=code_block_20, angle=code_block_21)
rotateAndTranslate_7 = Custom[rotateAndTranslate](geometry=rotateAndTranslate_6.Geometry, xTranslation=generateSide.x_translation, oldgeometry=generateSide.PolyCurve, divisions=code_block_20, Verticaldivisions=code_block_20, angle=code_block_21)
rotateAndTranslate_8 = Custom[rotateAndTranslate](geometry=rotateAndTranslate_7.Geometry, xTranslation=generateSide.x_translation, oldgeometry=generateSide.PolyCurve, divisions=code_block_20, Verticaldivisions=code_block_20, angle=code_block_21)
rotateAndTranslate_9 = Custom[rotateAndTranslate](geometry=rotateAndTranslate_8.Geometry, xTranslation=generateSide.x_translation, oldgeometry=generateSide.PolyCurve, divisions=code_block_20, Verticaldivisions=code_block_20, angle=code_block_21)
code_block_22 = CodeBlock { Autodesk.Point.ByCoordinates(0,20,0); Autodesk.Point.ByCoordinates(0,23,5); Autodesk.Point.ByCoordinates(0,20,15); }
byThreePoints = Arc.ByThreePoints(firstPoint=code_block_22.out0, secondPoint=code_block_22.out1, thirdPoint=code_block_22.out2)
code_block_23 = CodeBlock { Autodesk.Point.ByCoordinates(0,20,15); Autodesk.Point.ByCoordinates(0,15,20); Autodesk.Point.ByCoordinates(0,17,25); }
byThreePoints_2 = Arc.ByThreePoints(firstPoint=code_block_23.out0, secondPoint=code_block_23.out1, thirdPoint=code_block_23.out2)
code_block_24 = CodeBlock(a=byThreePoints, b=byThreePoints_2) { {a,b}; }
code_block_25 = CodeBlock { 0..1..#6; }
pointAtParameter = Curve.PointAtParameter(curve=code_block_24, param=code_block_25, lacing=CrossProduct)
flatten = Flatten(pointAtParameter)
byPoints = NurbsCurve.ByPoints(flatten)
code_block_26 = CodeBlock { 360; }
byRevolve = Surface.ByRevolve(byPoints, arg4=code_block_26)
code_block_27 = CodeBlock { 10; }
scale = Geometry.Scale(geometry=byRevolve, amount=code_block_27)
XY = Plane.XY()
mirror = Geometry.Mirror(geometry=scale, mirrorPlane=XY)
code_block_28 = CodeBlock { 10; }
lunchbox_quad_grid_by_face = Custom[LunchBox Quad Grid by Face](Surface=mirror, U=code_block_28, V=code_block_28)  # Create a quadrangular XYZ grid on a face. The face surface must have an untrimmed UV parameter space.
