# Dynamo graph pavDesigns22.dyn (Dynamo 0.9.1.4062)

number = DoubleInput(1000)
code_block = CodeBlock { -3000; }
byCoordinates = Point.ByCoordinates(x=number, y=code_block)
byCoordinates_2 = Point.ByCoordinates(y=code_block)
byStartPointEndPoint = Line.ByStartPointEndPoint(startPoint=byCoordinates, endPoint=byCoordinates_2)
code_block_2 = CodeBlock { 2000; }
translate = Geometry.Translate(geometry=byStartPointEndPoint, yTranslation=code_block_2)
code_block_3 = CodeBlock { 200; 500; }
translate_2 = Geometry.Translate(geometry=translate, yTranslation=code_block_3.out0, zTranslation=code_block_3.out1)
code_block_4 = CodeBlock { 200; 400; }
translate_3 = Geometry.Translate(geometry=translate_2, yTranslation=code_block_4.out1, zTranslation=code_block_4.out0)
create = List.Create(byStartPointEndPoint, translate, translate_2, translate_3)
byLoft = Surface.ByLoft(create)
code_block_5 = CodeBlock { 5; }
code_block_6 = CodeBlock { 100; }
lunchbox_space_truss_structure = Custom[LunchBox Space Truss Structure](Surface=byLoft, U=code_block_5, V=code_block_5, Depth=code_block_6)  # Create a space truss using a surface.
code_block_7 = CodeBlock(topedgesX=lunchbox_space_truss_structure.CenterlinesA) { topedgesX; }
code_block_8 = CodeBlock(topedgesY=lunchbox_space_truss_structure.CenterlinesB) { topedgesY; }
code_block_9 = CodeBlock(diagonals=lunchbox_space_truss_structure.CenterlinesE) { diagonals; }
code_block_10 = CodeBlock(x=code_block_7, y=code_block_8, z=code_block_9) { {x,y,z}; }
flatten = Flatten(code_block_10)
startPoint = Curve.StartPoint(flatten)
endPoint = Curve.EndPoint(flatten)
join = List.Join(startPoint, endPoint)
code_block_11 = CodeBlock { 6; }
code_block_12 = CodeBlock { 20; }
byLengths = Cuboid.ByLengths(width=code_block_12, length=code_block_12, height=code_block_12)
averageStrutsVector = WireFrameToRobot.OrientationStrategy.AverageStrutsVector()
byPointsLinesAndGeoOrientationStrategy = WireFrameToRobot.Node.ByPointsLinesAndGeoOrientationStrategy(join, flatten, code_block_11, byLengths, averageStrutsVector)
create_2 = List.Create(byStartPointEndPoint, translate)
code_block_13 = CodeBlock { -2000; }
translate_4 = Geometry.Translate(geometry=create_2, xTranslation=code_block_13)
byLoft_2 = Surface.ByLoft(translate_4)
code_block_14 = CodeBlock(a=translate_4) { a[1]; }
endPoint_2 = Curve.EndPoint(code_block_14)
code_block_15 = CodeBlock { 300; }
translate_5 = Geometry.Translate(geometry=endPoint_2, yTranslation=code_block_15, zTranslation=code_block_15)
YAxis = Vector.YAxis()
byStartPointEndPointStartTangent = Arc.ByStartPointEndPointStartTangent(endPoint_2, translate_5, YAxis)
extrude = Curve.Extrude(curve=byStartPointEndPointStartTangent, distance=number)
translate_6 = Geometry.Translate(geometry=translate_5, yTranslation=code_block_15, zTranslation=code_block_15)
code_block_16 = CodeBlock { 1; }
coordinateSystemAtParameter = Curve.CoordinateSystemAtParameter(byStartPointEndPointStartTangent, code_block_16)
YAxis_2 = CoordinateSystem.YAxis(coordinateSystemAtParameter)
byStartPointEndPointStartTangent_2 = Arc.ByStartPointEndPointStartTangent(translate_5, translate_6, YAxis_2)
code_block_17 = CodeBlock(x=number) { x*-1; }
extrude_2 = Curve.Extrude(curve=byStartPointEndPointStartTangent_2, distance=code_block_17)
flipNormalDirection = Surface.FlipNormalDirection(extrude_2)
create_3 = List.Create(byLoft_2, extrude, flipNormalDirection)
code_block_18 = CodeBlock { 3; }
code_block_19 = CodeBlock { 100; }
lunchbox_space_truss_structure_2 = Custom[LunchBox Space Truss Structure](Surface=create_3, U=code_block_18, V=code_block_18, Depth=code_block_19)
code_block_20 = CodeBlock(topedgesX=lunchbox_space_truss_structure_2.CenterlinesA) { topedgesX; }
code_block_21 = CodeBlock(topedgesY=lunchbox_space_truss_structure_2.CenterlinesB) { topedgesY; }
code_block_22 = CodeBlock(diagonals=lunchbox_space_truss_structure_2.CenterlinesE) { diagonals; }
code_block_23 = CodeBlock(x=code_block_20, y=code_block_21, z=code_block_22) { {x,y,z}; }
flatten_2 = Flatten(code_block_23)
startPoint_2 = Curve.StartPoint(flatten_2)
endPoint_3 = Curve.EndPoint(flatten_2)
join_2 = List.Join(startPoint_2, endPoint_3)
code_block_24 = CodeBlock { 6; }
code_block_25 = CodeBlock { 20; }
byLengths_2 = Cuboid.ByLengths(width=code_block_25, length=code_block_25, height=code_block_25)
averageStrutsVector_2 = WireFrameToRobot.OrientationStrategy.AverageStrutsVector()
byPointsLinesAndGeoOrientationStrategy_2 = WireFrameToRobot.Node.ByPointsLinesAndGeoOrientationStrategy(join_2, flatten_2, code_block_24, byLengths_2, averageStrutsVector_2)
code_block_26 = CodeBlock { 4; }
generateSide = Custom[generateSide](divisions=code_block_26, Verticaldivisions=code_block_26)  # test
code_block_27 = CodeBlock { -35; }
rotateAndTranslate = Custom[rotateAndTranslate](geometry=generateSide.PolyCurve, xTranslation=generateSide.x_translation, oldgeometry=generateSide.PolyCurve, divisions=code_block_26, Verticaldivisions=code_block_26, angle=code_block_27)  # rotate a parallelgram and translate
rotateAndTranslate_2 = Custom[rotateAndTranslate](geometry=rotateAndTranslate.Geometry, xTranslation=generateSide.x_translation, oldgeometry=generateSide.PolyCurve, divisions=code_block_26, Verticaldivisions=code_block_26, angle=code_block_27)
rotateAndTranslate_3 = Custom[rotateAndTranslate](geometry=rotateAndTranslate_2.Geometry, xTranslation=generateSide.x_translation, oldgeometry=generateSide.PolyCurve, divisions=code_block_26, Verticaldivisions=code_block_26, angle=code_block_27)
rotateAndTranslate_4 = Custom[rotateAndTranslate](geometry=rotateAndTranslate_3.Geometry, xTranslation=generateSide.x_translation, oldgeometry=generateSide.PolyCurve, divisions=code_block_26, Verticaldivisions=code_block_26, angle=code_block_27)
rotateAndTranslate_5 = Custom[rotateAndTranslate](geometry=rotateAndTranslate_4.Geometry, xTranslation=generateSide.x_translation, oldgeometry=generateSide.PolyCurve, divisions=code_block_26, Verticaldivisions=code_block_26, angle=code_block_27)
rotateAndTranslate_6 = Custom[rotateAndTranslate](geometry=rotateAndTranslate_5.Geometry, xTranslation=generateSide.x_translation, oldgeometry=generateSide.PolyCurve, divisions=code_block_26, Verticaldivisions=code_block_26, angle=code_block_27)
rotateAndTranslate_7 = Custom[rotateAndTranslate](geometry=rotateAndTranslate_6.Geometry, xTranslation=generateSide.x_translation, oldgeometry=generateSide.PolyCurve, divisions=code_block_26, Verticaldivisions=code_block_26, angle=code_block_27)
rotateAndTranslate_8 = Custom[rotateAndTranslate](geometry=rotateAndTranslate_7.Geometry, xTranslation=generateSide.x_translation, oldgeometry=generateSide.PolyCurve, divisions=code_block_26, Verticaldivisions=code_block_26, angle=code_block_27)
rotateAndTranslate_9 = Custom[rotateAndTranslate](geometry=rotateAndTranslate_8.Geometry, xTranslation=generateSide.x_translation, oldgeometry=generateSide.PolyCurve, divisions=code_block_26, Verticaldivisions=code_block_26, angle=code_block_27)
create_4 = List.Create(generateSide.PolyCurve, rotateAndTranslate.Geometry, rotateAndTranslate_2.Geometry, rotateAndTranslate_3.Geometry, rotateAndTranslate_4.Geometry, rotateAndTranslate.lines, rotateAndTranslate_2.lines, rotateAndTranslate_3.lines, rotateAndTranslate_4.lines, rotateAndTranslate_5.lines, rotateAndTranslate_6.Geometry, rotateAndTranslate_6.lines, rotateAndTranslate_7.Geometry, rotateAndTranslate_7.lines, rotateAndTranslate_8.Geometry, rotateAndTranslate_8.lines, rotateAndTranslate_9.Geometry, rotateAndTranslate_9.lines, generateSide.lines)
flatten_3 = Flatten(create_4)
code_block_28 = CodeBlock(lines=flatten_3) { lines; }
explode = Geometry.Explode(code_block_28)
flatten_4 = Flatten(explode)
startPoint_3 = Curve.StartPoint(flatten_4)
endPoint_4 = Curve.EndPoint(flatten_4)
byStartPointEndPoint_2 = Line.ByStartPointEndPoint(startPoint=startPoint_3, endPoint=endPoint_4)
code_block_29 = CodeBlock { 6; }
code_block_30 = CodeBlock { 20; }
byLengths_3 = Cuboid.ByLengths(width=code_block_30, length=code_block_30, height=code_block_30)
averageStrutsVector_3 = WireFrameToRobot.OrientationStrategy.AverageStrutsVector()
byPointsLinesAndGeoOrientationStrategy_3 = WireFrameToRobot.Node.ByPointsLinesAndGeoOrientationStrategy(startPoint_3, byStartPointEndPoint_2, code_block_29, byLengths_3, averageStrutsVector_3)
nodeGeometry = WireFrameToRobot.Node.NodeGeometry(byPointsLinesAndGeoOrientationStrategy_3)
code_block_31 = CodeBlock { Autodesk.Point.ByCoordinates(0,20,0); Autodesk.Point.ByCoordinates(0,23,5); Autodesk.Point.ByCoordinates(0,20,15); }
byThreePoints = Arc.ByThreePoints(firstPoint=code_block_31.out0, secondPoint=code_block_31.out1, thirdPoint=code_block_31.out2)
code_block_32 = CodeBlock { Autodesk.Point.ByCoordinates(0,20,15); Autodesk.Point.ByCoordinates(0,15,20); Autodesk.Point.ByCoordinates(0,17,25); }
byThreePoints_2 = Arc.ByThreePoints(firstPoint=code_block_32.out0, secondPoint=code_block_32.out1, thirdPoint=code_block_32.out2)
code_block_33 = CodeBlock(a=byThreePoints, b=byThreePoints_2) { {a,b}; }
code_block_34 = CodeBlock { 0..1..#6; }
pointAtParameter = Curve.PointAtParameter(curve=code_block_33, param=code_block_34, lacing=CrossProduct)
flatten_5 = Flatten(pointAtParameter)
byPoints = NurbsCurve.ByPoints(flatten_5)
code_block_35 = CodeBlock { 360; }
byRevolve = Surface.ByRevolve(byPoints, arg4=code_block_35)
code_block_36 = CodeBlock { 10; }
scale = Geometry.Scale(geometry=byRevolve, amount=code_block_36)
XY = Plane.XY()
mirror = Geometry.Mirror(geometry=scale, mirrorPlane=XY)
code_block_37 = CodeBlock { 10; }
lunchbox_quad_grid_by_face = Custom[LunchBox Quad Grid by Face](Surface=mirror, U=code_block_37, V=code_block_37)  # Create a quadrangular XYZ grid on a face. The face surface must have an untrimmed UV parameter space.
code_block_38 = CodeBlock(lines=lunchbox_quad_grid_by_face.Panel_Polys) { lines; }
explode_2 = Geometry.Explode(code_block_38)
flatten_6 = Flatten(explode_2)
startPoint_4 = Curve.StartPoint(flatten_6)
endPoint_5 = Curve.EndPoint(flatten_6)
byStartPointEndPoint_3 = Line.ByStartPointEndPoint(startPoint=startPoint_4, endPoint=endPoint_5)
code_block_39 = CodeBlock { 6; }
code_block_40 = CodeBlock { 20; }
byLengths_4 = Cuboid.ByLengths(width=code_block_40, length=code_block_40, height=code_block_40)
averageStrutsVector_4 = WireFrameToRobot.OrientationStrategy.AverageStrutsVector()
byPointsLinesAndGeoOrientationStrategy_4 = WireFrameToRobot.Node.ByPointsLinesAndGeoOrientationStrategy(startPoint_4, byStartPointEndPoint_3, code_block_39, byLengths_4, averageStrutsVector_4)
findUniqueStruts = WireFrameToRobot.Node.FindUniqueStruts(byPointsLinesAndGeoOrientationStrategy_4)
