# Dynamo graph paviliondesignAuBaseSurfaceTestAlignedPlanes.dyn (Dynamo 0.9.1.4062)

file_path = Filename("C:\Users\Mike\Desktop\au2015sat.sat")
importFromSAT = Geometry.ImportFromSAT(file_path)
code_block = CodeBlock { 888; }
scale = Geometry.Scale(geometry=importFromSAT, amount=code_block)
byGeometry = BoundingBox.ByGeometry(scale)
toCuboid = BoundingBox.ToCuboid(byGeometry)
findUniqueStruts = WireFrameToRobot.Node.FindUniqueStruts()
totalStrutLength = WireFrameToRobot.Node.TotalStrutLength()
code_block_2 = CodeBlock { 5; }
lunchbox_triangle_grid_by_face = Custom[LunchBox Triangle Grid by Face](Surface=scale, U=code_block_2, V=code_block_2)  # Create a Triangular XYZ grid on a face. The face surface must have an untrimmed UV parameter space.
code_block_3 = CodeBlock(lines=lunchbox_triangle_grid_by_face.Panel_Polys) { lines; }
explode = Geometry.Explode(code_block_3)
flatten = Flatten(explode)
startPoint = Curve.StartPoint(flatten)
endPoint = Curve.EndPoint(flatten)
byStartPointEndPoint = Line.ByStartPointEndPoint(startPoint=startPoint, endPoint=endPoint)
code_block_4 = CodeBlock { 6; }
code_block_5 = CodeBlock { 20; }
byLengths = Cuboid.ByLengths(width=code_block_5, length=code_block_5, height=code_block_5)
averageStrutsVector = WireFrameToRobot.OrientationStrategy.AverageStrutsVector()
byPointsLinesAndGeoOrientationStrategy = WireFrameToRobot.Node.ByPointsLinesAndGeoOrientationStrategy(startPoint, byStartPointEndPoint, code_block_4, byLengths, averageStrutsVector)
code_block_6 = CodeBlock(a=byPointsLinesAndGeoOrientationStrategy) { a[0]; }
struts = WireFrameToRobot.Node.Struts(code_block_6)
transformedCutPlane = WireFrameToRobot.Strut.TransformedCutPlane(struts)
byPlane = CoordinateSystem.ByPlane(transformedCutPlane)
transformedAndAlignedCutPlane = WireFrameToRobot.Strut.TransformedAndAlignedCutPlane(struts)
byPlane_2 = CoordinateSystem.ByPlane(transformedAndAlignedCutPlane)
code_block_7 = CodeBlock { 2; }
translate = Geometry.Translate(geometry=byPlane_2, yTranslation=code_block_7)
