# Dynamo graph surfaces.dyn (Dynamo 0.9.1.4062)

number = DoubleInput(10)
code_block = CodeBlock { -20; }
number_slider = DoubleSlider(6.079, range=0..100 step 0.1)
byCoordinates = Point.ByCoordinates(x=number, y=code_block, z=number_slider)
number_slider_2 = DoubleSlider(6.1, range=0..100 step 0.1)
byCoordinates_2 = Point.ByCoordinates(y=code_block, z=number_slider_2)
byStartPointEndPoint = Line.ByStartPointEndPoint(startPoint=byCoordinates, endPoint=byCoordinates_2)
code_block_2 = CodeBlock { 10; }
translate = Geometry.Translate(geometry=byStartPointEndPoint, yTranslation=code_block_2)
create = List.Create(byStartPointEndPoint, translate)
byLoft = Surface.ByLoft()
code_block_3 = CodeBlock { 4; }
code_block_4 = CodeBlock { 1; }
lunchbox_space_truss_structure = Custom[LunchBox Space Truss Structure](Surface=byLoft, U=code_block_3, V=code_block_3, Depth=code_block_4)  # Create a space truss using a surface.
code_block_5 = CodeBlock(topedgesX=lunchbox_space_truss_structure.CenterlinesA) { topedgesX; }
code_block_6 = CodeBlock(topedgesY=lunchbox_space_truss_structure.CenterlinesB) { topedgesY; }
code_block_7 = CodeBlock(diagonals=lunchbox_space_truss_structure.CenterlinesE) { diagonals; }
code_block_8 = CodeBlock { 4; }
generateSide = Custom[generateSide](divisions=code_block_8, Verticaldivisions=code_block_8)  # test
rotateAndTranslate = Custom[rotateAndTranslate](geometry=generateSide.PolyCurve, xTranslation=generateSide.x_translation, oldgeometry=generateSide.PolyCurve, divisions=code_block_8, Verticaldivisions=code_block_8)  # rotate a parallelgram and translate
rotateAndTranslate_2 = Custom[rotateAndTranslate](geometry=rotateAndTranslate.Geometry, xTranslation=generateSide.x_translation, oldgeometry=generateSide.PolyCurve, divisions=code_block_8, Verticaldivisions=code_block_8)
rotateAndTranslate_3 = Custom[rotateAndTranslate](geometry=rotateAndTranslate_2.Geometry, xTranslation=generateSide.x_translation, oldgeometry=generateSide.PolyCurve, divisions=code_block_8, Verticaldivisions=code_block_8)
rotateAndTranslate_4 = Custom[rotateAndTranslate](geometry=rotateAndTranslate_3.Geometry, xTranslation=generateSide.x_translation, oldgeometry=generateSide.PolyCurve, divisions=code_block_8, Verticaldivisions=code_block_8)
