# Dynamo graph testingDifferenceFailure.dyn (Dynamo 0.9.1.4062)

byLengths = Cuboid.ByLengths()
code_block = CodeBlock { 1..10; }
shuffle = List.Shuffle(code_block)
shuffle_2 = List.Shuffle(code_block)
shuffle_3 = List.Shuffle(code_block)
code_block_2 = CodeBlock(x=shuffle, y=shuffle_2, z=shuffle_3) { Autodesk.Point.ByCoordinates(0,0,0); Autodesk.Point.ByCoordinates(x,y,z); }
byStartPointEndPoint = Line.ByStartPointEndPoint(startPoint=code_block_2.out0, endPoint=code_block_2.out1)
code_block_3 = CodeBlock { 0; }
planeAtParameter = Curve.PlaneAtParameter(curve=byStartPointEndPoint, param=code_block_3)
code_block_4 = CodeBlock { 0.2; }
byPlaneRadius = Circle.ByPlaneRadius(plane=planeAtParameter, radius=code_block_4)
sweepAsSolid = Curve.SweepAsSolid(byPlaneRadius, byStartPointEndPoint)
differenceAll = Solid.DifferenceAll(byLengths, sweepAsSolid)
